# Dynamo graph AdaptiveComponentFromExcel.dyn (Dynamo 2.0.3.8810)

# group: read from excel
# note: Navigate to PanelPoints.xlsx (if you have Excel installed) in your sample files.
file_path = Filename(".\PanelPoints.xlsx")  # graph input
fromPath = FileObject(path=file_path)  # "File.FromPath"
code_block = CodeBlock { "Sheet1"; }
importExcel = Data.ImportExcel(file=fromPath, sheetName=code_block)

deconstruct = List.Deconstruct(list=importExcel)

# group: Example: how to separate into matched lists of x, y, z coordinates
watch = Watch(deconstruct.first)
code_block_2 = CodeBlock(titleRow=deconstruct.first) { titleRow; }
code_block_3 = CodeBlock { 3; }
chop = List.Chop(list=code_block_2, lengths=code_block_3)
transpose = List.Transpose(lists=chop)
watch_2 = Watch(transpose)

# group: Turn Excel numbers into sets of points
code_block_4 = CodeBlock { 3; }
chop_2 = List.Chop(list=deconstruct.rest@L2, lengths=code_block_4)
code_block_5 = CodeBlock { false; }
clean = List.Clean(list=chop_2, preserveIndices=code_block_5)
transpose_2 = List.Transpose(lists=clean@L3)
code_block_6 = CodeBlock { 0; 1; 2; }
getItemAtIndex = List.GetItemAtIndex(list=transpose_2@L3, index=code_block_6.out0)
getItemAtIndex_2 = List.GetItemAtIndex(list=transpose_2@L3, index=code_block_6.out1)
getItemAtIndex_3 = List.GetItemAtIndex(list=transpose_2@L3, index=code_block_6.out2)
byCoordinates = Point.ByCoordinates(x=getItemAtIndex, y=getItemAtIndex_2, z=getItemAtIndex_3)

# group: Groups sublists by the number of points they contain
count = List.Count(list=byCoordinates@L2)
groupByKey = List.GroupByKey(list=byCoordinates, keys=count)
code_block_7 = CodeBlock(pts=groupByKey.groups) { pts[0]; pts[1]; pts[2]; }

# group: place adaptive components in Revit
family_types = FamilyTypes(index=0)  # graph input
byPoints = AdaptiveComponent.ByPoints(points=code_block_7.out0, familyType=family_types)
family_types_2 = FamilyTypes(index=1)  # graph input
byPoints_2 = AdaptiveComponent.ByPoints(points=code_block_7.out1, familyType=family_types_2)
family_types_3 = FamilyTypes(index=2)  # graph input
byPoints_3 = AdaptiveComponent.ByPoints(points=code_block_7.out2, familyType=family_types_3)

# group: read from csv
# note: The method to read data from a csv file is similar.  Navigate to PanelPoints.csv
file_path_2 = Filename(".\PanelPoints.csv")  # graph input
importCSV = Data.ImportCSV(filePath=file_path_2)

transpose_3 = List.Transpose()  # unwired: lists
