# Dynamo graph 03 Truss - Custom Node.dyn (Dynamo 1.3.2.2480)

origin = Point.Origin()
code_block = CodeBlock { 20; }
byCoordinates = Point.ByCoordinates(x=code_block)
byStartPointEndPoint = Line.ByStartPointEndPoint(startPoint=origin, endPoint=byCoordinates)
number_of_vertical_members = DoubleSlider(8, range=0..20 step 1)
code_block_2 = CodeBlock(numVerts=number_of_vertical_members) { 0..1..#numVerts; }
truss_depth = DoubleSlider(6.94, range=0..10 step 0.01)
createTruss = Custom[CreateTruss](curve=byStartPointEndPoint, numOfCells=code_block_2, depth=truss_depth)  # Create a truss by a base curve, number of cells and height
watch = Watch(createTruss)
