# Dynamo graph 04 Truss - Apply to surfaces.dyn (Dynamo 2.0.3.8810)

# note: Select a single face from a Revit element.  This returns a list because some faces in Revit are composed of multiple surfaces (as in where two walls meet).
select_face = DSFaceSelection()  # 1 picked in the model; graph input
firstItem = List.FirstItem(list=select_face)
integer_slider = IntegerSlider(8, range=0..15 step 1)  # graph input
# note: Use this with the sample file RoofSurfaces.rvt
code_block = CodeBlock(numOfIsoCurves=integer_slider) { 0..1..#numOfIsoCurves; }

# group: extract isocurves from the surface to form the base curves for the truss
getIsoline = Surface.GetIsoline(surface=firstItem, parameter=code_block)

code_block_2 = CodeBlock { 16; 5; }
createTruss = Custom[CreateTruss](curve=getIsoline, numOfCells=code_block_2.out0, depth=code_block_2.out1)  # Create a truss by a base curve, number of cells and height
select_model_element = DSModelElementSelection()  # 1 picked in the model; graph input
geometry = Element.Geometry(element=select_model_element)
explode = Geometry.Explode(geometry=geometry)
flatten = List.Flatten(list=explode)

# group: Get the lowest surface from the solid by sorting the surfaces according to the z-coordinate of their center point.
code_block_3 = CodeBlock { 0.5; }
pointAtParameter = Surface.PointAtParameter(surface=flatten, u=code_block_3, v=code_block_3)
Z = Point.Z(point=pointAtParameter)
sortByKey = List.SortByKey(list=flatten, keys=Z)
firstItem_2 = List.FirstItem(list=sortByKey.sorted_list)

integer_slider_2 = IntegerSlider(8, range=0..15 step 1)  # graph input

# group: extract isocurves from the surface to form the base curves for the truss
code_block_4 = CodeBlock(numOfIsoCurves=integer_slider_2) { 0..1..#numOfIsoCurves; }
getIsoline_2 = Surface.GetIsoline(surface=firstItem_2, parameter=code_block_4)

code_block_5 = CodeBlock { 16; 5; }
createTruss_2 = Custom[CreateTruss](curve=getIsoline_2, numOfCells=code_block_5.out0, depth=code_block_5.out1)
select_model_element_2 = DSModelElementSelection()  # 1 picked in the model; graph input
geometry_2 = Element.Geometry(element=select_model_element_2)
firstItem_3 = List.FirstItem(list=geometry_2)
integer_slider_3 = IntegerSlider(8, range=0..15 step 1)  # graph input

# group: extract isocurves from the surface to form the base curves for the truss
code_block_6 = CodeBlock(numOfIsoCurves=integer_slider_3) { 0..1..#numOfIsoCurves; }
getIsoline_3 = Surface.GetIsoline(surface=firstItem_3, parameter=code_block_6)

code_block_7 = CodeBlock { 16; 5; }
createTruss_3 = Custom[CreateTruss](curve=getIsoline_3, numOfCells=code_block_7.out0, depth=code_block_7.out1)
