# Dynamo custom node CreateTruss.dyf (Dynamo 1.3.2.2480)
# category: MyCustomNodes
# Create a truss by a base curve, number of cells and height

curve = Input(curve : Curve)
numOfCells = Input(numOfCells : int)
code_block = CodeBlock(numOfCells=numOfCells) { 0..1..#numOfCells; }

# group: create top points
# note: the reference curve for the truss will be the upper line of the truss
pointAtParameter = Curve.PointAtParameter(curve=curve, param=code_block)

depth = Input(depth : double)
code_block_2 = CodeBlock(depth=depth) { -depth; }

# group: create bottom points by copying top points
translate = Geometry.Translate(geometry=pointAtParameter, zTranslation=code_block_2)

# group: top and bottom lines of the truss
byPoints = PolyCurve.ByPoints(points=pointAtParameter)
explode = Geometry.Explode(byPoints)
byPoints_2 = PolyCurve.ByPoints(points=translate)
explode_2 = Geometry.Explode(byPoints_2)

# group: create vertical lines
byStartPointEndPoint = Line.ByStartPointEndPoint(startPoint=pointAtParameter, endPoint=translate)

# group: create diagonal lines of the truss
restOfItems = List.RestOfItems(pointAtParameter)
byStartPointEndPoint_2 = Line.ByStartPointEndPoint(startPoint=restOfItems, endPoint=translate)

join = List.Join(explode, explode_2, byStartPointEndPoint, byStartPointEndPoint_2)
curves = Output(join)
