# Dynamo graph 00 Create Lists.dyn (Dynamo 1.3.2.2480)

code_block = CodeBlock { 3; 8; 1.3; }
range = Range(start=code_block.out0, end=code_block.out1, step=code_block.out2, lacing=Longest)
code_block_2 = CodeBlock { -3; 6; 2; }
sequence = Sequence(start=code_block_2.out0, amount=code_block_2.out1, step=code_block_2.out2, lacing=Longest)
code_block_3 = CodeBlock()
# ---------- code_block_3.designscript (2 lines) ----------
// start..end..step
3..8..1.3;
# ----------------------------------------
code_block_4 = CodeBlock()
# ---------- code_block_4.designscript (2 lines) ----------
// start..#amount..step
-3..#6..2;
# ----------------------------------------
code_block_5 = CodeBlock()
# ---------- code_block_5.designscript (2 lines) ----------
// start..end..#amount
0..1..#7;
# ----------------------------------------
code_block_6 = CodeBlock()
# ---------- code_block_6.designscript (2 lines) ----------
//start..end
1..4;
# ----------------------------------------
