# Dynamo graph 02 Truss - Add StructuralFraming.dyn (Dynamo 1.3.2.2480)

# group: get curve from revit
select_model_element = DSModelElementSelection()  # 1 picked in the model
geometry = Element.Geometry(select_model_element)
firstItem = List.FirstItem(geometry)

number_of_vertical_members = DoubleSlider(8, range=0..20 step 1)
code_block = CodeBlock(numVerts=number_of_vertical_members) { 0..1..#numVerts; }

# group: create top points
# note: the reference curve for the truss will be the upper line of the truss
pointAtParameter = Curve.PointAtParameter(curve=firstItem, param=code_block)

truss_depth = DoubleSlider(6.25, range=0..10 step 0.01)
code_block_2 = CodeBlock(depth=truss_depth) { -depth; }

# group: create bottom points by copying top points
translate = Geometry.Translate(geometry=pointAtParameter, zTranslation=code_block_2)

# group: top and bottom lines of the truss
byPoints = PolyCurve.ByPoints(points=pointAtParameter)
explode = Geometry.Explode(byPoints)
byPoints_2 = PolyCurve.ByPoints(points=translate)
explode_2 = Geometry.Explode(byPoints_2)

# group: create vertical lines
byStartPointEndPoint = Line.ByStartPointEndPoint(startPoint=pointAtParameter, endPoint=translate)

# group: create diagonal lines of the truss
restOfItems = List.RestOfItems(pointAtParameter)
byStartPointEndPoint_2 = Line.ByStartPointEndPoint(startPoint=restOfItems, endPoint=translate)

# group: place structural framing in revit
join = List.Join(explode, explode_2, byStartPointEndPoint, byStartPointEndPoint_2)
levels = Levels("Level 2")
structural_framing_types = StructuralFramingTypes("W12X26")
beamByCurve = StructuralFraming.BeamByCurve(curve=join, level=levels, structuralFramingType=structural_framing_types)
