# Dynamo custom node DropShadow.dyf (Dynamo 2.0.2.6826)
# category: MyCustomNodes

solid = Input(solid: Autodesk.DesignScript.Geometry.Topology)
direction = Input(direction: Autodesk.DesignScript.Geometry.Vector)

# group: get shadow dropped by the building mass
deconstructFacadeShell = Autodesk.RefineryToolkits.MassingSandbox.Generate.Building.DeconstructFacadeShell(solid=solid)
vertices = Topology.Vertices(topology=deconstructFacadeShell.horizontalSrfList)
pointGeometry = Vertex.PointGeometry(vertex=vertices)
code_block = CodeBlock(a=pointGeometry) { a[0]; a[1]; }
code_block_2 = CodeBlock { -3000; }
byStartPointDirectionLength = Line.ByStartPointDirectionLength(startPoint=code_block.out0, direction=direction, length=code_block_2)
XY = Plane.XY()
intersect = Geometry.Intersect(geometry=byStartPointDirectionLength, other=XY)
join = List.Join(list0=code_block.out1, list1=intersect)
flatten = List.Flatten(list=join)
python_script = Python(IN[0]=flatten)
# ---------- python_script.python (37 lines) ----------
import clr
clr.AddReference('ProtoGeometry')
from Autodesk.DesignScript.Geometry import *
# based on a script found here:
# http://en.wikibooks.org/wiki/Algorithm_Implementation/Geometry/Convex_hull/Monotone_chain#Python

points = IN[0]
#reformat points list
newpoints = list()
for point in points:
	newpoint = (point.X,point.Y)
	newpoints.append(newpoint)
points = sorted(set(newpoints))

def cross(o, a, b):
	return (a[0] - o[0]) * (b[1] - o[1]) - (a[1] - o[1]) * (b[0] - o[0])
 
if len(points) <= 1:
	OUT = points
else:
	lower = []
	for p in points:
		while len(lower) >= 2 and cross(lower[-2], lower[-1], p) <= 0:
			lower.pop()
		lower.append(p)
	upper = []
	for p in reversed(points):
		while len(upper) >= 2 and cross(upper[-2], upper[-1], p) <= 0:
			upper.pop()
		upper.append(p)
	convex_hull = lower[:-1] + upper[:-1]
	
	toReturn = []
	for p in convex_hull:
		toReturn.append(Point.ByCoordinates(p[0], p[1], 0))
	
	OUT = Polygon.ByPoints(toReturn)
# ----------------------------------------
byPatch = Surface.ByPatch(closedCurve=python_script)

shadow = Output(byPatch)  # "shadow: Surface"
outline = Output(python_script)  # "outline: Curve"
