# Dynamo graph ThreeSolidTower_00_CreateBuildingMass.dyn (Dynamo 2.1.0.7500)

# group: ThreeSolidTower_00 Create Building Mass
# note: ADDITIONAL COMMENTS
# N/A
# note: REQUIRED DYNAMO PACKAGES
# Ampersand
# Refinery Toolkit for Massing
# Refinery Toolkit for Space Planning
# note: DYNAMO VERSION
# 2.0.2+
# note: DYNAMO PROJECT
# ThreeSolidTower_00_CreateBuildingMass.dyn
# note: ASSOCIATED FILE(S)
# N/A
# note: AUTHOR(S) / CREATION DATE
# Varvara Toulkeridou, Refinery Team
# varvara.toulkeridou@autodesk.com
# September 2019
# note: DESCRIPTION
# N/A

# group: CONTEXT: site outline
XY = Plane.XY()
code_block = CodeBlock { 70; }
byWidthLength = Rectangle.ByWidthLength(plane=XY, width=code_block, length=code_block)

byPatch = Surface.ByPatch(closedCurve=byWidthLength)
perimeterCurves = Surface.PerimeterCurves(surface=byPatch)

# group: INPUTS: u, v for variable corner point
u1 = DoubleSlider(0.9, range=0..1 step 0.1)  # graph input
v1 = DoubleSlider(0.1, range=0..1 step 0.1)  # graph input

# group: GENERATOR: Create mass outline
endPoint = Curve.EndPoint(curve=perimeterCurves)
code_block_2 = CodeBlock { 2; }
code_block_3 = CodeBlock { 0.5; }
divideSurface = Autodesk.RefineryToolkits.SpacePlanning.Generate.SurfaceDivision2D.DivideSurface(surface=byPatch, U=code_block_3, V=code_block_3)
code_block_4 = CodeBlock(a=divideSurface) { a[0]; }
pointAtParameter = Surface.PointAtParameter(surface=code_block_4, u=u1, v=v1)
replaceItemAtIndex = List.ReplaceItemAtIndex(list=endPoint, index=code_block_2, item=pointAtParameter)
byPoints = Polygon.ByPoints(points=replaceItemAtIndex)

# group: INPUTS: splitting parameters
param_1 = DoubleSlider(0.6, range=0..1 step 0.1)  # graph input
param_2 = DoubleSlider(0.5, range=0..1 step 0.1)  # graph input
param_3 = DoubleSlider(0.6, range=0..1 step 0.1)  # graph input
list_create = List.Create(item0=param_1, item1=param_2, item2=param_3)

# group: GENERATOR: Split base surface in three parts
code_block_5 = CodeBlock(massPolygon=byPoints, sitePerimeterCurves=perimeterCurves, splittngParameters=list_create) { massPolygon; sitePerimeterCurves; splittngParameters; }
byPatch_2 = Surface.ByPatch(closedCurve=code_block_5.massPolygon)
center = Polygon.Center(polygon=code_block_5.massPolygon)
code_block_6 = CodeBlock { 3; }
removeItemAtIndex = List.RemoveItemAtIndex(list=code_block_5.sitePerimeterCurves, indices=code_block_6)
pointAtParameter_2 = Curve.PointAtParameter(curve=removeItemAtIndex, param=code_block_5.splittngParameters)
byStartPointEndPoint = Line.ByStartPointEndPoint(startPoint=center, endPoint=pointAtParameter_2)
geometry_splitbytools = Custom[[&] Geometry.SplitByTools](geometry=byPatch_2, tools=byStartPointEndPoint)  # Split one piece of geometry (other than a polysurface) by multiple tools

# group: EVALUATOR: calculate open area
thicken = Surface.Thicken(surface=byPatch_2)
subtractFrom = Surface.SubtractFrom(surface=byPatch, trimmingEntity=thicken)
area = Surface.Area(surface=subtractFrom@L1)
sum = Math.Sum(values=area)
open_area = Watch(sum)  # graph output

# group: INPUTS: volume heights
height_01 = DoubleSlider(65, range=5..65 step 0.1)
height_02 = DoubleSlider(150, range=5..150 step 0.1)
height_03 = DoubleSlider(171.8, range=5..255 step 0.1)
list_create_2 = List.Create(item0=height_01, item1=height_02, item2=height_03)

# group: GENERATOR: Create building volume
code_block_7 = CodeBlock { false; }
thicken_2 = Surface.Thicken(surface=geometry_splitbytools, thickness=list_create_2, both_sides=code_block_7)
byUnion = Solid.ByUnion(solids=thicken_2)

# group: EVALUATOR: calculate total facade area
deconstructFacadeShell = Autodesk.RefineryToolkits.MassingSandbox.Generate.Building.DeconstructFacadeShell(solid=byUnion)
code_block_8 = CodeBlock(verticalSrfs=deconstructFacadeShell.verticalSrfList) { verticalSrfs; }
area_2 = Surface.Area(surface=code_block_8)
sum_2 = Math.Sum(values=area_2)
facade_area = Watch(sum_2)  # graph output

# group: Display: color building mass
color_palette = ColorPalette({R: 112, G: 184, B: 208, A: 198})
byGeometryColor = Modifiers.GeometryColor.ByGeometryColor(geometry=byUnion, color=color_palette)

# group: Display: color building mass outline
edges = Topology.Edges(topology=byUnion)
curveGeometry = Edge.CurveGeometry(edge=edges)
color_palette_2 = ColorPalette({R: 240, G: 248, B: 255, A: 255})
byGeometryColor_2 = Modifiers.GeometryColor.ByGeometryColor(geometry=curveGeometry, color=color_palette_2)
