# Dynamo graph ThreeSolidTower_02.dyn (Dynamo 2.0.2.6826)

# group: INTEGRATE: Select site volume from Revit
# note: Select a Revit mass representing the volumetric constraints of a site (heights, setbacks, etc)
select_model_element = DSModelElementSelection()  # 1 picked in the model

# group: INPUTS: move corner point
u1 = DoubleSlider(0.9, range=0..1 step 0.1)  # graph input
v1 = DoubleSlider(0.3, range=0..1 step 0.1)  # graph input

# group: INPUTS: splitting parameters
param_1 = DoubleSlider(0.6, range=0..1 step 0.1)  # graph input
param_2 = DoubleSlider(0.4, range=0..1 step 0.1)  # graph input
param_3 = DoubleSlider(0.8, range=0..1 step 0.1)  # graph input

# group: INPUTS: volume heights
height_01 = DoubleSlider(171.8, range=5..255 step 0.1)
height_02 = DoubleSlider(150, range=5..150 step 0.1)
height_03 = DoubleSlider(65, range=5..65 step 0.1)

height_list = List.Create(item0=height_01, item1=height_02, item2=height_03)
code_block = CodeBlock { false; }

# group: INTEGRATE: Select urban context from Revit
# note: Select a Revit mass representing the urban context.
select_model_element_2 = DSModelElementSelection()  # 1 picked in the model

# group: INTEGRATE: Convert to Dynamo objects
solids = Element.Solids(element=select_model_element)
remember = Data.Remember(solids)
byUnion = Solid.ByUnion(solids=remember)
solids_2 = Element.Solids(element=select_model_element_2)
remember_2 = Data.Remember(solids_2)

# group: Extract site outline
bySolid = PolySurface.BySolid(solid=byUnion)
surfaces = PolySurface.Surfaces(polySurface=bySolid)
number = DoubleInput(0.5)
pointAtParameter = Surface.PointAtParameter(surface=surfaces, u=number, v=number)
Z = Point.Z(point=pointAtParameter)
sortByKey = List.SortByKey(list=surfaces, keys=Z)
number_2 = DoubleInput(0)
getItemAtIndex = List.GetItemAtIndex(list=sortByKey.sorted_list, index=number_2)

code_block_2 = CodeBlock(siteSurface=getItemAtIndex) { siteSurface; }

# group: extract list of fixed points
perimeterCurves = Surface.PerimeterCurves(surface=code_block_2)
endPoint = Curve.EndPoint(curve=perimeterCurves)
code_block_3 = CodeBlock { 2; }
removeItemAtIndex = List.RemoveItemAtIndex(list=endPoint, indices=code_block_3)

# group: extract variable point
code_block_4 = CodeBlock { [0.5]; }
divideSurface = Autodesk.RefineryToolkits.SpacePlanning.Generate.SurfaceDivision2D.DivideSurface(surface=code_block_2, U=code_block_4, V=code_block_4)
code_block_5 = CodeBlock(a=divideSurface) { a[0]; }
pointAtParameter_2 = Surface.PointAtParameter(surface=code_block_5, u=u1, v=v1)

# group: GENERATOR: get building outline
insert = List.Insert(list=removeItemAtIndex, element=pointAtParameter_2, index=code_block_3)
byPoints = Polygon.ByPoints(points=insert)
reverse = Curve.Reverse(curve=byPoints)

perimeterCurves_2 = Surface.PerimeterCurves(surface=code_block_2)
code_block_6 = CodeBlock(a=perimeterCurves_2) { a[0]; a[1]; a[2]; }

# group: GENERATOR: Split base surface
byPatch = Surface.ByPatch(closedCurve=reverse)
pointAtParameter_3 = Curve.PointAtParameter(curve=code_block_6.out0, param=param_1)
center = Polygon.Center(polygon=reverse)
byStartPointEndPoint = Line.ByStartPointEndPoint(startPoint=pointAtParameter_3, endPoint=center)
pointAtParameter_4 = Curve.PointAtParameter(curve=code_block_6.out1, param=param_2)
byStartPointEndPoint_2 = Line.ByStartPointEndPoint(startPoint=pointAtParameter_4, endPoint=center)
pointAtParameter_5 = Curve.PointAtParameter(curve=code_block_6.out2, param=param_3)
byStartPointEndPoint_3 = Line.ByStartPointEndPoint(startPoint=pointAtParameter_5, endPoint=center)
list_create = List.Create(item0=byStartPointEndPoint, item1=byStartPointEndPoint_2, item2=byStartPointEndPoint_3)
python_script = Python(IN[0]=byPatch, IN[1]=list_create)
# ---------- python_script.python (36 lines) ----------
#
# Colin McCrone
# Twitter:  https://twitter.com/colinmccrone
# LinkedIn: https://www.linkedin.com/in/colinmccrone
# Updated:  2016-05-15
#
import clr
clr.AddReference('ProtoGeometry')
from Autodesk.DesignScript.Geometry import *

def Flatten2D(ls):
	flat = []	
	for x in ls:
		if type(x) is list:
			for y in x:
				flat.append(y)
		else:
			flat.append(x)	
	return flat

# Main function
geom = IN[0]
tools = IN[1]

pieces = []
pieces.append(geom)

for tool in tools:
	assert type(tool) is not list
	newPieces = []
	for piece in pieces:
		assert type(piece) is not list
		newPieces.append(Flatten2D(Geometry.Split(piece,tool)))
	pieces = Flatten2D(newPieces)

OUT = pieces
# ----------------------------------------

# group: EVALUATOR: calculate open area
thicken = Surface.Thicken(surface=byPatch)
subtractFrom = Surface.SubtractFrom(surface=code_block_2, trimmingEntity=thicken)
area = Surface.Area(surface=subtractFrom@L1)
sum = Math.Sum(values=area)
open_area = Watch(sum)  # graph output

# group: GENERATOR: Create building volume
code_block_7 = CodeBlock(a=python_script) { a[0]; a[1]; a[2]; }
code_block_8 = CodeBlock { false; }
thicken_2 = Surface.Thicken(surface=code_block_7.out0, thickness=height_01, both_sides=code_block_8)
thicken_3 = Surface.Thicken(surface=code_block_7.out1, thickness=height_02, both_sides=code_block_8)
thicken_4 = Surface.Thicken(surface=code_block_7.out2, thickness=height_03, both_sides=code_block_8)
solids_list = List.Create(item0=thicken_2, item1=thicken_3, item2=thicken_4)
byUnion_2 = Solid.ByUnion(solids=solids_list)

# group: EVALUATOR: calculate total facade area
deconstructFacadeShell = Autodesk.RefineryToolkits.MassingSandbox.Generate.Building.DeconstructFacadeShell(solid=byUnion_2)
code_block_9 = CodeBlock(verticalSrfs=deconstructFacadeShell.verticalSrfList) { verticalSrfs; }
area_2 = Surface.Area(surface=code_block_9)
sum_2 = Math.Sum(values=area_2)
facade_area = Watch(sum_2)  # graph output

# group: DISPLAY: color building mass
color_palette = ColorPalette({R: 112, G: 184, B: 208, A: 164})
byGeometryColor = Modifiers.GeometryColor.ByGeometryColor(geometry=byUnion_2, color=color_palette)

# group: GENERATOR: create floors
floorHeight = DoubleInput(5)
code_block_10 = CodeBlock(height=height_list, FloorHeight=floorHeight) { 0..height..FloorHeight; }
byCoordinates = Point.ByCoordinates(z=code_block_10)
byOriginNormal = Plane.ByOriginNormal(origin=byCoordinates)
intersect = Geometry.Intersect(geometry=solids_list, other=byOriginNormal)
flatten = List.Flatten(list=intersect@L3)
clean = List.Clean(list=flatten, preserveIndices=code_block)

# group: EVALUATOR: calculate floor area
area_3 = Surface.Area(surface=clean)
flatten_2 = List.Flatten(list=area_3)
sum_3 = Math.Sum(values=flatten_2)
floorArea = Watch(sum_3)

# group: DISPLAY: color floor perimeter curves
perimeterCurves_3 = Surface.PerimeterCurves(surface=clean)
color_palette_2 = ColorPalette({R: 255, G: 255, B: 240, A: 255})
byGeometryColor_2 = Modifiers.GeometryColor.ByGeometryColor(geometry=perimeterCurves_3, color=color_palette_2)

# group: DISPLAY: color zoning boundary
bySolid_2 = PolySurface.BySolid(solid=byUnion)
surfaces_2 = PolySurface.Surfaces(polySurface=bySolid_2)
perimeterCurves_4 = Surface.PerimeterCurves(surface=surfaces_2)
number_3 = DoubleInput(255)
number_4 = DoubleInput(115)
byARGB = Color.ByARGB(r=number_3, b=number_4)
byGeometryColor_3 = Modifiers.GeometryColor.ByGeometryColor(geometry=perimeterCurves_4, color=byARGB)

# group: DISPLAY: color site context
number_5 = DoubleInput(40)
number_6 = DoubleInput(255)
byARGB_2 = Color.ByARGB(a=number_5, r=number_6, g=number_6, b=number_6)
byGeometryColor_4 = Modifiers.GeometryColor.ByGeometryColor(geometry=remember_2, color=byARGB_2)

# group: INTEGRATE: Output Revit floors
byJoinedCurves = PolyCurve.ByJoinedCurves(curves=perimeterCurves_3)
floor_types = FloorTypes(index=2)
boolean = BoolSelector(false)
code_block_11 = CodeBlock(levels=code_block_10) { levels; }
code_block_12 = CodeBlock { null; }
if_ = If(test=boolean, true=code_block_11, false=code_block_12)
string = StringInput("Mass_Level_")
add = string + if_
byElevationAndName = Level.ByElevationAndName(elevation=if_, name=add)
byOutlineTypeAndLevel = Floor.ByOutlineTypeAndLevel(outline=byJoinedCurves, floorType=floor_types, level=byElevationAndName)
