# Dynamo graph ThreeSolidTower_02_IntegrateWithRevit.dyn (Dynamo 2.1.0.7500)

# group: ThreeSolidTower_02 Integrate with Revit
# note: ADDITIONAL COMMENTS
# N/A
# note: REQUIRED DYNAMO PACKAGES
# Ampersand
# Refinery Toolkit for Massing
# Refinery Toolkit for Space Planning
# note: DYNAMO PROJECT
# ThreeSolidTower_02_IntegrateWithRevit.dyn
# note: ASSOCIATED FILE(S)
# UrbanContext.rvt
# note: AUTHOR(S) / CREATION DATE
# Varvara Toulkeridou, Refinery Team
# varvara.toulkeridou@autodesk.com
# September 2019
# note: DESCRIPTION
# N/A
# note: DYNAMO VERSION
# 2.0.2+

# group: INTEGRATOR: Select site volume from Revit
# note: Select a Revit mass representing the volumetric constraints of a site (heights, setbacks, etc)
select_model_element = DSModelElementSelection()  # 1 picked in the model

# group: INPUTS: u, v for variable corner point
u1 = DoubleSlider(0.9, range=0..1 step 0.1)  # graph input
v1 = DoubleSlider(0.1, range=0..1 step 0.1)  # graph input

# group: INPUTS: splitting parameters
param_1 = DoubleSlider(0.6, range=0..1 step 0.1)  # graph input
param_2 = DoubleSlider(0.5, range=0..1 step 0.1)  # graph input
param_3 = DoubleSlider(0.6, range=0..1 step 0.1)  # graph input
list_create = List.Create(item0=param_1, item1=param_2, item2=param_3)

# group: INPUTS: volume heights
height_01 = DoubleSlider(54.6, range=5..200 step 0.1)
height_02 = DoubleSlider(183.9, range=5..200 step 0.1)
height_03 = DoubleSlider(118.6, range=5..200 step 0.1)
list_create_2 = List.Create(item0=height_01, item1=height_02, item2=height_03)

# group: GENERATOR: create floors
floorHeight = DoubleInput(5)
code_block = CodeBlock(height=list_create_2, FloorHeight=floorHeight) { 0..height..FloorHeight; }
code_block_2 = CodeBlock { -1; }
dropItems = List.DropItems(list=code_block@L2, amount=code_block_2)
byCoordinates = Point.ByCoordinates(z=dropItems)
byOriginNormal = Plane.ByOriginNormal(origin=byCoordinates)

# group: INTEGRATOR: Select urban context from Revit
# note: Select a Revit mass representing the urban context.
select_model_element_2 = DSModelElementSelection()  # 1 picked in the model

# group: INTEGRATOR: Convert to Dynamo objects
solids = Element.Solids(element=select_model_element)
remember = Data.Remember(solids)
byUnion = Solid.ByUnion(solids=remember)
solids_2 = Element.Solids(element=select_model_element_2)
remember_2 = Data.Remember(solids_2)

# group: Extract site outline
bySolid = PolySurface.BySolid(solid=byUnion)
surfaces = PolySurface.Surfaces(polySurface=bySolid)
number = DoubleInput(0.5)
pointAtParameter = Surface.PointAtParameter(surface=surfaces, u=number, v=number)
Z = Point.Z(point=pointAtParameter)
sortByKey = List.SortByKey(list=surfaces, keys=Z)
number_2 = DoubleInput(0)
getItemAtIndex = List.GetItemAtIndex(list=sortByKey.sorted_list, index=number_2)

code_block_3 = CodeBlock(siteSurface=getItemAtIndex) { siteSurface; }
perimeterCurves = Surface.PerimeterCurves(surface=code_block_3)

# group: GENERATOR: Create mass outline
endPoint = Curve.EndPoint(curve=perimeterCurves)
code_block_4 = CodeBlock { 2; }
code_block_5 = CodeBlock { 0.5; }
divideSurface = Autodesk.RefineryToolkits.SpacePlanning.Generate.SurfaceDivision2D.DivideSurface(surface=code_block_3, U=code_block_5, V=code_block_5)
code_block_6 = CodeBlock(a=divideSurface) { a[0]; }
pointAtParameter_2 = Surface.PointAtParameter(surface=code_block_6, u=u1, v=v1)
replaceItemAtIndex = List.ReplaceItemAtIndex(list=endPoint, index=code_block_4, item=pointAtParameter_2)
byPoints = Polygon.ByPoints(points=replaceItemAtIndex)
reverse = Curve.Reverse(curve=byPoints)

# group: GENERATOR: Split base surface in three parts
code_block_7 = CodeBlock(massPolygon=reverse, sitePerimeterCurves=perimeterCurves, splittngParameters=list_create) { massPolygon; sitePerimeterCurves; splittngParameters; }
byPatch = Surface.ByPatch(closedCurve=code_block_7.massPolygon)
center = Polygon.Center(polygon=code_block_7.massPolygon)
code_block_8 = CodeBlock { 3; }
removeItemAtIndex = List.RemoveItemAtIndex(list=code_block_7.sitePerimeterCurves, indices=code_block_8)
pointAtParameter_3 = Curve.PointAtParameter(curve=removeItemAtIndex, param=code_block_7.splittngParameters)
byStartPointEndPoint = Line.ByStartPointEndPoint(startPoint=center, endPoint=pointAtParameter_3)
geometry_splitbytools = Custom[[&] Geometry.SplitByTools](geometry=byPatch, tools=byStartPointEndPoint)  # Split one piece of geometry (other than a polysurface) by multiple tools

# group: EVALUATOR: calculate open area
thicken = Surface.Thicken(surface=byPatch)
subtractFrom = Surface.SubtractFrom(surface=code_block_3, trimmingEntity=thicken)
area = Surface.Area(surface=subtractFrom@L1)
sum = Math.Sum(values=area)
open_area = Watch(sum)  # graph output

# group: GENERATOR: create building volume
lastItem = List.LastItem(list=code_block@L2)
code_block_9 = CodeBlock { false; }
thicken_2 = Surface.Thicken(surface=geometry_splitbytools, thickness=lastItem, both_sides=code_block_9)
byUnion_2 = Solid.ByUnion(solids=thicken_2)

# group: EVALUATOR: calculate total facade area
deconstructFacadeShell = Autodesk.RefineryToolkits.MassingSandbox.Generate.Building.DeconstructFacadeShell(solid=byUnion_2)
code_block_10 = CodeBlock(verticalSrfs=deconstructFacadeShell.verticalSrfList) { verticalSrfs; }
area_2 = Surface.Area(surface=code_block_10)
sum_2 = Math.Sum(values=area_2)
facade_area = Watch(sum_2)  # graph output

# group: Display: color building mass
color_palette = ColorPalette({R: 112, G: 184, B: 208, A: 198})
byGeometryColor = Modifiers.GeometryColor.ByGeometryColor(geometry=byUnion_2, color=color_palette)

# group: Display: color building mass outline
edges = Topology.Edges(topology=byUnion_2)
curveGeometry = Edge.CurveGeometry(edge=edges)
color_palette_2 = ColorPalette({R: 240, G: 248, B: 255, A: 255})
byGeometryColor_2 = Modifiers.GeometryColor.ByGeometryColor(geometry=curveGeometry, color=color_palette_2)

# group (continued): GENERATOR: create floors
intersect = Geometry.Intersect(geometry=thicken_2, other=byOriginNormal)
flatten = List.Flatten(list=intersect@L3)

# group: EVALUATOR: calculate floor area
area_3 = Surface.Area(surface=flatten)
flatten_2 = List.Flatten(list=area_3)
sum_3 = Math.Sum(values=flatten_2)
floorArea = Watch(sum_3)

# group: Display: color floor perimeter curves
perimeterCurves_2 = Surface.PerimeterCurves(surface=flatten)
color_palette_3 = ColorPalette({R: 255, G: 255, B: 240, A: 255})
byGeometryColor_3 = Modifiers.GeometryColor.ByGeometryColor(geometry=perimeterCurves_2, color=color_palette_3)

# group: DISPLAY: color zoning boundary
bySolid_2 = PolySurface.BySolid(solid=byUnion)
surfaces_2 = PolySurface.Surfaces(polySurface=bySolid_2)
perimeterCurves_3 = Surface.PerimeterCurves(surface=surfaces_2)
color_palette_4 = ColorPalette({R: 255, G: 20, B: 147, A: 255})
byGeometryColor_4 = Modifiers.GeometryColor.ByGeometryColor(geometry=perimeterCurves_3, color=color_palette_4)

# group: DISPLAY: color site context
color_palette_5 = ColorPalette({R: 211, G: 211, B: 211, A: 107})
byGeometryColor_5 = Modifiers.GeometryColor.ByGeometryColor(geometry=remember_2, color=color_palette_5)

# group: INTEGRATOR: Name Revit levels
boolean = BoolSelector(false)
code_block_11 = CodeBlock(levels=code_block) { levels; }
code_block_12 = CodeBlock { null; }
if_ = If(test=boolean, true=code_block_11, false=code_block_12)
code_block_13 = CodeBlock { "a"; }
count = List.Count(list=code_block_11)
sequence = Sequence(start=code_block_13, amount=count)
count_2 = List.Count(list=code_block_11@L2)
code_block_14 = CodeBlock(mass_prefix=sequence, levels=code_block_11, levelsCount=count_2) { mass_prefix; levels; level_numbers = 0..levelsCount; "Mass_" + mass_prefix + "_level_" + level_numbers; }
byElevationAndName = Level.ByElevationAndName(elevation=if_, name=code_block_14.out3)

# group: INTEGRATOR: Create Revit levels
byJoinedCurves = PolyCurve.ByJoinedCurves()  # unwired: curves
floor_types = FloorTypes()  # nothing selected
byOutlineTypeAndLevel = Floor.ByOutlineTypeAndLevel(outline=byJoinedCurves, floorType=floor_types, level=byElevationAndName)
